# Dynamo graph DesignScript.dyn (Dynamo 2.13.1.3887)

# group: Design Script
boolean = BoolSelector(false)
python_script = Python(IN[0]=boolean)  # CPython3
# ---------- python_script.python (3 lines) ----------
f = open(r"D:\Training dynamo\Code dynamo python\HOC-CODE-DYNAMO-2024\DisegnScrpt.py", "r")

OUT = f.read() 
# ----------------------------------------
python_script_from_string = PythonStringNode(script=python_script)  # CPython3; unwired: IN[0], IN[1]
